# Grasshopper definition circle_holes.gh (Grasshopper 1.0.7)

# ---- group: Box
number_slider = Slider(9.677, range=0..10)
box = CenterBox(Base=PlaneXY(0, 0, 0), X=number_slider, Y=number_slider, Z=Slider(10, range=0..10))
debrep = DeconstructBrep(Brep=box)  # -> Faces, Edges, Vertices

# ----
lenseg = SegmentLengths(Curve=debrep.Edges)  # -> ShortestLength, ShortestDomain, LongestLength, LongestDomain
sort = SortList(Keys=lenseg.ShortestDomain)  # -> Keys, ValuesA
number_slider_2 = Slider(8, range=0..20)
rev = ReverseList(List=sort.Keys)
item = ListItem(List=rev, Index=0, Wrap=True)
item_2 = ListItem(List=debrep.Faces, Index=1, Wrap=True)

# ---- group: Surface 1
item_3 = ListItem(List=debrep.Faces, Index=0, Wrap=True)
sdivide = DivideSurface(Surface=item_3, UCount=number_slider_2, VCount=number_slider_2)  # -> Points, Normals, Parameters
flip = FlipMatrix(Data=sdivide.Points)
viewer = ParamViewer(sdivide.Points)
viewer_2 = ParamViewer(flip)
lng = ListLength(List=viewer)
lng_2 = ListLength(List=viewer_2)
subtraction = Subtraction(A=lng, B=1)
subtraction_2 = Subtraction(A=lng_2, B=1)
cull_i = CullIndex(List=viewer, Indices=[lng, subtraction, Slider(0, range=0..6)], Wrap=True)
cull_i_2 = CullIndex(List=viewer_2, Indices=[lng_2, subtraction_2, Slider(0, range=0..6)], Wrap=True)
branch = TreeBranch(Tree=sdivide.Points, Path=cull_i, MaintainPaths=True)
branch_2 = TreeBranch(Tree=flip, Path=cull_i_2, MaintainPaths=True)
intersection = SetIntersection(SetA=branch, SetB=flatten(branch_2))

# ---- group: Random Attractor Point Selector
lng_3 = ListLength(List=flatten(sdivide.Points))
dom = ConstructDomain(DomainStart=0, DomainEnd=lng_3)
random = Random(Range=dom, Number=Slider(4, range=0..5), Seed=Slider(10, range=0..20))
round = Round(Number=random)  # -> Nearest, Floor, Ceiling
item_4 = ListItem(List=flatten(sdivide.Points), Index=round.Nearest, Wrap=True)

# ---- group: Surface 2
sdivide_2 = DivideSurface(Surface=item_2, UCount=number_slider_2, VCount=number_slider_2)  # -> Points, Normals, Parameters
flip_2 = FlipMatrix(Data=sdivide_2.Points)
viewer_3 = ParamViewer(sdivide_2.Points)
viewer_4 = ParamViewer(flip_2)
lng_4 = ListLength(List=viewer_3)
lng_5 = ListLength(List=viewer_4)
subtraction_3 = Subtraction(A=lng_4, B=1)
subtraction_4 = Subtraction(A=lng_5, B=1)
cull_i_3 = CullIndex(List=viewer_3, Indices=[lng_4, subtraction_3, Slider(0, range=0..6)], Wrap=True)
cull_i_4 = CullIndex(List=viewer_4, Indices=[lng_5, subtraction_4, Slider(0, range=0..6)], Wrap=True)
branch_3 = TreeBranch(Tree=flip_2, Path=cull_i_4, MaintainPaths=True)
branch_4 = TreeBranch(Tree=sdivide_2.Points, Path=cull_i_3, MaintainPaths=True)
intersection_2 = SetIntersection(SetA=branch_4, SetB=flatten(branch_3))

# ----
jitter = Jitter(Jitter=1, Seed=2)  # -> Values, Indices
c_script = CSharpScript()  # -> Out, A, B
pt2num = PointsToNumbers(Points=item_4, Mask=4)
addition = Addition(A=pt2num, B=5)
num2pt = NumbersToPoints(Numbers=addition, Mask=4)

# ---- group: Cutout
flatten = FlattenTree(Tree=intersection, Path="{0}")
dist = Distance(PointA=flatten, PointB=item_4)
division = Division(A=dist, B=item)
circle = CircleCNR(Center=flatten, Normal=item_3, Radius=division)
project = Project(Curve=circle, Brep=item_3, Direction=item_3)
path_mapper = PathMapper(project, source="{A;B;C}", target="{A}")
srfsplit = SurfaceSplit(Surface=item_3, Curves=path_mapper)
item_5 = ListItem(List=srfsplit, Index=0, Wrap=True)

# ---- group: Cutout 2
flatten_2 = FlattenTree(Tree=intersection_2, Path="{0}")
dist_2 = Distance(PointA=flatten_2, PointB=flatten(num2pt))
division_2 = Division(A=dist_2, B=item)
circle_2 = CircleCNR(Center=flatten_2, Normal=item_2, Radius=division_2)
project_2 = Project(Curve=circle_2, Brep=item_2, Direction=item_2)
path_mapper_2 = PathMapper(project_2, source="{A;B;C}", target="{A}")
srfsplit_2 = SurfaceSplit(Surface=item_2, Curves=path_mapper_2)
item_6 = ListItem(List=srfsplit_2, Index=0, Wrap=True)

# ----
panel = Panel(division)
panel_2 = Panel(division_2)
intersection_3 = SetIntersection(SetA=division, SetB=panel_2)
