# Grasshopper definition framing_visualiser.gh (Grasshopper 0.9.76)

panel = Panel("Floors")
f2f_spacing_between_slabs = Slider(2.7, range=0..5)
number_of_floors = Slider(8, range=0..15)
panel_2 = Panel("vertical spacing")
panel_3 = Panel("number of floors")
slab_array = Series(Start=0, F2FSpacingBetweenSlabsM=f2f_spacing_between_slabs, NumberOfSlabs=number_of_floors)
panel_4 = Panel("base shape")
base_shape = PlaneSurface(Plane=PlaneXY(0, 0, 0), XSize=Slider(40, range=5..50), YSize=Slider(40, range=5..50))
Z = UnitZ(Factor=slab_array)
move = Move(Geometry=graft(base_shape), Motion=Z)  # -> Geometry, Transform
Z_2 = UnitZ(Factor=0.1)
extr = Extrude(Base=move.Geometry, Direction=Z_2)
sdiff = SolidDifference(BrepsA=move.Geometry, BrepsB=extr)

panel_5 = Panel("Columns")
panel_6 = Panel("number of columns")

item = ListItem(List=slab_array, Index=expr("x-1", number_of_floors), Wrap=True)
Z_3 = UnitZ(Factor=item)

columns_in_x_direction = Slider(7, range=0..50)
columns_in_y_direction = Slider(7, range=0..50)
columns = DivideSurface(Surface=base_shape, UCount=columns_in_x_direction, VCount=columns_in_y_direction)  # -> Points, Normals, Parameters
item_2 = ListItem(List=flatten(columns.Points), Index=0, Wrap=True)
branch = TreeBranch(Tree=columns.Points, Path="{0;0;1}", MaintainPaths=True)
item_3 = ListItem(List=flatten(columns.Points), Index=0, Wrap=True)
item_4 = ListItem(List=flatten(columns.Points), Index=1, Wrap=True)
item_5 = ListItem(List=flatten(branch), Index=0, Wrap=True)
dist = Distance(PointA=item_2, PointB=item_5)
dist_2 = Distance(PointA=item_3, PointB=item_4)

length_along_y = Slider(0.5, range=0..5)
length_along_x = Slider(0.45, range=0..5)
panel_7 = Panel("column dimensions")
division = Division(A=length_along_x, B=2)
division_2 = Division(A=length_along_y, B=2)
neg = Negative(Value=division)
neg_2 = Negative(Value=division_2)
dom = ConstructDomain(DomainStart=neg_2, DomainEnd=division_2)
dom_2 = ConstructDomain(DomainStart=neg, DomainEnd=division)
column_dimensions = DomainBox(Base=columns.Points, X=dom_2, Y=dom, Z=Z_3)

expression = Expression(x=dist_2, y=length_along_y, Expression="(y-x)/12")
expression_2 = Expression(x=dist, y=length_along_x, Expression="(y-x)/12")
abs = Absolute(Value=expression_2)
abs_2 = Absolute(Value=expression)
max = Maximum(A=abs, B=abs_2)

flatten = FlattenTree(Tree=columns.Parameters, Path="{0}")
branch_2 = TreeBranch(Tree=columns.Parameters, Path="{0;0;0}", MaintainPaths=True)
branch_3 = TreeBranch(Tree=columns.Parameters, Path="{0;0;1}", MaintainPaths=True)
item_6 = ListItem(List=branch_3, Index=0, Wrap=True)
item_7 = ListItem(List=branch_2, Index=0, Wrap=True)
item_8 = ListItem(List=flatten, Index=0, Wrap=True)
item_9 = ListItem(List=flatten, Index=1, Wrap=True)
dist_3 = Distance(PointA=item_7, PointB=item_6)
path_mapper = PathMapper(columns.Parameters, source="{A;B;C}(i)", target="{A;B;C}(1)")
path_mapper_2 = PathMapper(columns.Parameters, source="{A;B;C}(i)", target="{i}(A)")
dist_4 = Distance(PointA=item_8, PointB=item_9)
panel_8 = Panel("Beams")
multiplication = Multiplication(A=columns_in_x_direction, B=dist_3)
multiplication_2 = Multiplication(A=columns_in_y_direction, B=dist_4)
neg_3 = Negative(Value=multiplication)
neg_4 = Negative(Value=multiplication_2)
dom_3 = ConstructDomain(DomainStart=0, DomainEnd=neg_3)
dom_4 = ConstructDomain(DomainStart=0, DomainEnd=max)
dom_5 = ConstructDomain(DomainStart=0, DomainEnd=max)
dom_6 = ConstructDomain(DomainStart=0, DomainEnd=neg_4)
beams_along_y_axis = DomainBox(Base=path_mapper_2, X=dom_3, Y=dom, Z=dom_4)
beams_along_y_axis_2 = DomainBox(Base=path_mapper, X=dom_2, Y=dom_6, Z=dom_5)
move_2 = Move(Geometry=beams_along_y_axis, Motion=Z)  # -> Geometry, Transform
move_3 = Move(Geometry=beams_along_y_axis_2, Motion=Z)  # -> Geometry, Transform
trim = TrimSolid(Shape=[move_2.Geometry, move_3.Geometry], Cutters=column_dimensions)
trim_2 = TrimSolid(Shape=column_dimensions, Cutters=move_2.Geometry)

debox = DeconstructBox(Box=trim)  # -> Plane, X, Y, Z
Z_4 = UnitZ(Factor=debox.Z)
move_4 = Move(Geometry=sdiff, Motion=Z_4)  # -> Geometry, Transform
