# Grasshopper definition hypar.gh (Grasshopper 0.9.76)

number_slider = Slider(12, range=0..100)
number_slider_2 = Slider(12, range=0..100)
number_slider_3 = Slider(12, range=0..100)
length = Slider(20, range=0..100)
neg = Negative(Value=number_slider_2)
pt = ConstructPoint(XCoordinate=0, YCoordinate=0, ZCoordinate=0)
pt_2 = ConstructPoint(XCoordinate=number_slider, YCoordinate=number_slider_2, ZCoordinate=number_slider_3)
pt_3 = ConstructPoint(XCoordinate=number_slider, YCoordinate=neg, ZCoordinate=number_slider_3)
pt_4 = ConstructPoint(XCoordinate=length, YCoordinate=0, ZCoordinate=0)
ln = Line(StartPoint=pt, EndPoint=pt_2)
ln_2 = Line(StartPoint=pt_3, EndPoint=pt_4)
divide = DivideCurve(Curve=ln, Count=10, Kinks=False)  # -> Points, Tangents, Parameters
divide_2 = DivideCurve(Curve=ln_2, Count=10, Kinks=False)  # -> Points, Tangents, Parameters
ln_3 = Line(StartPoint=divide.Points, EndPoint=divide_2.Points)
loft = Loft(Curves=ln_3, Options={Adjust=False, Closed=False, LoftEnds=0, LoftSimp=0, LoftType=0, Rebuild=10, Refit=0.01})
divide_3 = DivideDomain²(Domain=loft, UCount=10, VCount=10)
surface_pipes = SurfaceBox(Surface=loft, Domain=loft, Height=-0.1)
subsrf = Isotrim(Surface=loft, Domain=divide_3)
area = Area(Geometry=subsrf)  # -> Area, Centroid
scale = Scale(Geometry=subsrf, Center=area.Centroid, Factor=0.9)  # -> Geometry, Transform
boxes = SurfaceBox(Surface=scale.Geometry, Domain=divide_3, Height=-0.1)
sdiff = SolidDifference(BrepsA=loft, BrepsB=boxes)
