# Grasshopper definition lexical_(youtube_sample).gh (Grasshopper 1.0.7)

# ---- group: Trunk
step = Slider(23, range=0..100)
count = Slider(10, range=0..100)
series = Series(Start=0, Step=step, Count=count)
pt = ConstructPoint(XCoordinate=0, YCoordinate=0, ZCoordinate=series)

# ----
X = UnitX(Factor=pt)
move = Move(Geometry=pt, Motion=X)  # -> Geometry, Transform
viewer = ParamViewer(pt)
count_2 = Slider(6, range=0..15)
step_2 = Slider(60, range=0..100)
graft = GraftTree(Tree=pt, IncludeEmptyLists=True, IncludeNullItems=True)
series_2 = Series(Start=0, Step=step_2, Count=count_2)
X_2 = UnitX(Factor=series_2)
move_2 = Move(Geometry=graft, Motion=X_2)  # -> Geometry, Transform
viewer_2 = ParamViewer(graft)
viewer_3 = ParamViewer(move_2.Geometry)
count_3 = Slider(5, range=0..15)
step_3 = Slider(2, range=0..100)
series_3 = Series(Start=0, Step=step_3, Count=count_3)
intcrv = Interpolate(Vertices=pt, Degree=3, Periodic=False, KnotStyle=1)  # -> Curve, Length, Domain
cull_i = CullIndex(List=viewer_3, Indices=series_3, Wrap=True)
branch = TreeBranch(Tree=move_2.Geometry, Path=cull_i, MaintainPaths=True)
count_4 = Slider(15, range=0..15)
cull_i_2 = CullIndex(List=branch, Indices=0, Wrap=True)
panel = Panel(branch)
intcrv_2 = Interpolate(Vertices=cull_i_2, Degree=3, Periodic=False, KnotStyle=1)  # -> Curve, Length, Domain
points = PointList(Points=cull_i_2, Size=count_4)
count_5 = Slider(15, range=0..15)
count_6 = Slider(15, range=0..15)
xz = XZPlane(Origin=cull_i_2)
count_7 = Slider(5, range=0..15)
step_4 = Slider(21, range=0..100)
cir = Circle(Plane=xz, Radius=count_6)
series_4 = Series(Start=0, Step=step_4, Count=count_7)
Z = UnitZ(Factor=series_4)
rev = Reverse(Vector=Z)
count_8 = Slider(5, range=0..15)
move_3 = Move(Geometry=cir, Motion=rev)  # -> Geometry, Transform
divide = DivideCurve(Curve=move_3.Geometry, Count=10, Kinks=False)  # -> Points, Tangents, Parameters
item = ListItem(List=divide.Points, Index=count_8, Wrap=True)
pshift = ShiftPaths(Data=item, Offset=-1)
intcrv_3 = Interpolate(Vertices=pshift, Degree=3, Periodic=False, KnotStyle=1)  # -> Curve, Length, Domain
