# Grasshopper definition rotation_temp.gh (Grasshopper 1.0.8)

degrees = Slider(-43, range=-90..90)
length = Slider(12, range=0..100)
rad = Radians(Degrees=degrees)
line = LineSDL(Start=Point(0, 0, 0), Direction=Vector(48.62458515, 0, 0), Length=100)
Y = UnitY(Factor=length)
divide = DivideCurve(Curve=line, Count=10, Kinks=False)  # -> Points, Tangents, Parameters
L = Length(15)
rev = Reverse(Vector=Y)
move = Move(Geometry=divide.Points, Motion=rev)  # -> Geometry, Transform
line_2 = LineSDL(Start=Point(0, 0, 0), Direction=Vector(0, -16.45762102, 0), Length=L)
len = Length(Curve=line_2)
ln = Line(StartPoint=divide.Points, EndPoint=move.Geometry)
rot3d = Rotate3D(Geometry=ln, Angle=rad, Center=divide.Points, Axis=Vector(0, 0, 1))  # -> Geometry, Transform
rotate = RotateDirection(Geometry=ln, Center=divide.Points, From=Vector(0, -36.38027736, 0), To=Vector(-21.20731507, -26.33517427, 0))  # -> Geometry, Transform
end = EndPoints(Curve=rot3d.Geometry)  # -> Start, End
line_3 = LineSDL(Start=end.End, Direction=Vector(0, 9.49641867, 0), Length=length)
