# Grasshopper definition solar path_simplified.gh (Grasshopper 1.0.8)

scale = Slider(63.949, range=0..100)
xz = XZPlane(Origin=Point(0, 0, 0))
arc = Arc(Plane=xz, Radius=scale, Angle=Domain(0, 3.141592654))  # -> Arc, Length
midpt = CurveMiddle(Curve=arc.Arc)
P = Plane(PlaneXY(0, 0, 0))
yz = YZPlane(Origin=Point(0, 0, 0))
A = Angle([23.5, -23.5])
end = EndPoints(Curve=arc.Arc)  # -> Start, End
ln = Line(StartPoint=midpt, EndPoint=P)
cos = Cosine(Value=degrees(A))
dec_range = Rotate(Geometry=ln, Angle=degrees(A), Plane=yz)  # -> Geometry, Transform
end_2 = EndPoints(Curve=dec_range.Geometry)  # -> Start, End
multiplication = Multiplication(A=cos, B=scale)
lines_to_dec_range = LineSDL(Start=end_2.Start, Direction=Vector(0, 0, -50.2698038), Length=multiplication)
end_3 = EndPoints(Curve=lines_to_dec_range)  # -> Start, End
sort_pt = SortPoints(Points=[midpt, end_3.Start])  # -> Points, Indices
xz_2 = XZPlane(Origin=Point(0, 0, 0))
Y = UnitY(Factor=end_3.End)
dec_range_arc = Interpolate(Vertices=sort_pt.Points, Degree=3, Periodic=False, KnotStyle=1)  # -> Curve, Length, Domain
arc_2 = Arc(Plane=xz_2, Radius=multiplication, Angle=Domain(0, 3.141592654))  # -> Arc, Length
rev = Reverse(Vector=Y)
surface_opening_height_from_ground = Slider(0, range=0..100)
width = Slider(37, range=0..100)
latitude = Slider(23.414, range=-90..90)
day_of_the_year = Slider(45, range=1..183)
hour_1 = Slider(3, range=0..11)
minute_1 = Slider(30, range=0..59)
second_1 = Slider(42, range=0..59)
hour_2 = Slider(7, range=0..11)
second_2 = Slider(56, range=0..59)
length = Slider(22, range=0..100)
minute_2 = Slider(24, range=0..59)
move = Move(Geometry=arc_2.Arc, Motion=[Y, rev])  # -> Geometry, Transform
dom = ConstructDomain(DomainStart=1, DomainEnd=180)
time = ConstructTime(Hour=0, Minute=0, Second=0)
time_2 = ConstructTime(Hour=12, Minute=0, Second=0)
remap = RemapNumbers(Value=day_of_the_year, Source=dom, Target=dec_range_arc.Length)  # -> Mapped, Clipped
time_3 = ConstructTime(Hour=hour_1, Minute=minute_1, Second=second_1)
time_4 = ConstructTime(Hour=hour_2, Minute=minute_2, Second=second_2)
dec_pt = EvaluateCurve(Curve=dec_range_arc.Curve, Parameter=remap.Clipped)  # -> Point, Tangent, Angle
latitude_2 = Arc3Pt(PointA=end.Start, PointB=dec_pt.Point, PointC=end.End)  # -> Arc, Plane, Radius
dom_2 = ConstructDomain(DomainStart=time, DomainEnd=time_2)
len = Length(Curve=latitude_2.Arc)
remap_2 = RemapNumbers(Value=time_3, Source=dom_2, Target=len)  # -> Mapped, Clipped
remap_3 = RemapNumbers(Value=time_4, Source=dom_2, Target=len)  # -> Mapped, Clipped
date_points = EvaluateCurve(Curve=latitude_2.Arc, Parameter=[remap_3.Clipped, remap_2.Clipped])  # -> Point, Tangent, Angle
neg = Negative(Value=latitude)
date_lines = Line(StartPoint=date_points.Point, EndPoint=Point(0, 0, 0))
rad = Radians(Degrees=neg)
division = Division(A=length, B=2)
division_2 = Division(A=width, B=2)
rotated_elements = Rotate3D(
    Geometry=[move.Geometry, dec_range_arc.Curve, latitude_2.Arc, date_lines, midpt],
    Angle=rad,
    Center=Point(0, 0, 0),
    Axis=Vector(-117.2510483, 0, 0))  # -> Geometry, Transform
Z = UnitZ(Factor=surface_opening_height_from_ground)
neg_2 = Negative(Value=division)
neg_3 = Negative(Value=division_2)
dom_3 = ConstructDomain(DomainStart=neg_3, DomainEnd=division_2)
dom_4 = ConstructDomain(DomainStart=neg_2, DomainEnd=division)
move_2 = Move(Geometry=rotated_elements.Geometry, Motion=Z)  # -> Geometry, Transform
item = ListItem(List=move_2.Geometry, Index=6, Wrap=True)
item_2 = ListItem(List=move_2.Geometry, Index=7, Wrap=True)
item_3 = ListItem(List=move_2.Geometry, Index=[6, 7], Wrap=True)
rectangle = Rectangle(Plane=PlaneXY(0, 0, 0), XSize=dom_3, YSize=dom_4, Radius=0)  # -> Rectangle, Length
item_4 = ListItem(List=item_3, Index=0, Wrap=True)
item_5 = ListItem(List=item_3, Index=1, Wrap=True)
end_4 = EndPoints(Curve=item)  # -> Start, End
end_5 = EndPoints(Curve=item_2)  # -> Start, End
boxrec = BoxRectangle(Rectangle=rectangle.Rectangle, Height=Slider(31, range=0..100))
colour = ColourPicker(PickedColour=RGB(189, 128, 128))
height_of_overhang_from_incidence = Slider(7.029, range=0..100)
debrep = DeconstructBrep(Brep=boxrec)  # -> Faces, Edges, Vertices
item_6 = ListItem(List=debrep.Faces, Index=[0, 2, 5], Wrap=True)  # -> graft(Item)
bcx = BrepCurve(Brep=item_6, Curve=[item_4, item_5])  # -> Curves, flatten(Points)
item_7 = ListItem(List=bcx.Points, Index=1, Wrap=True)
item_8 = ListItem(List=bcx.Points, Index=0, Wrap=True)
Z_2 = UnitZ(Factor=height_of_overhang_from_incidence)
preview = CustomPreview(Geometry=boxrec, Material=colour)
item_9 = ListItem(List=flatten(item_6), Index=0, Wrap=True)
sun_coverage = _4PointSurface(CornerA=end_4.Start, CornerB=end_5.Start, CornerC=item_7, CornerD=item_8)
move_3 = Move(Geometry=[item_7, item_8], Motion=Z_2)  # -> Geometry, Transform
line = LineSDL(Start=move_3.Geometry, Direction=Vector(0, -96.9473087, 0), Length=1)
overhang_thickness = Slider(0.381, range=0..1)
ln2pl = Line2Plane(Line=line, PlaneA=item_9, PlaneB=sun_coverage)
intcrv = Interpolate(Vertices=move_3.Geometry, Degree=3, Periodic=False, KnotStyle=1)  # -> Curve, Length, Domain
Z_3 = UnitZ(Factor=overhang_thickness)
overhang = Loft(Curves=ln2pl, Options={Adjust=False, Closed=False, LoftEnds=0, LoftSimp=0, LoftType=0, Rebuild=10, Refit=0.01})
bbx = BrepBrep(BrepA=boxrec, BrepB=overhang)  # -> Curves, Points
overhang_extrusion = Extrude(Base=overhang, Direction=Z_3)
project = Project(Geometry=sun_coverage, Plane=overhang)  # -> Geometry, Transform
edges = BrepEdges(Brep=project.Geometry)  # -> Naked, Interior, NonManifold
colour_2 = ColourPicker(PickedColour=RGBA(255, 255, 255, 128))
bbx_2 = BrepBrep(BrepA=project.Geometry, BrepB=sun_coverage)  # -> Curves, Points
item_10 = ListItem(List=edges.Naked, Index=1, Wrap=True)
item_11 = ListItem(List=edges.Naked, Index=3, Wrap=True)
split = SplitWithBrep(Curve=item_10, Brep=sun_coverage)  # -> Curve, Points
split_2 = SplitWithBrep(Curve=item_11, Brep=sun_coverage)  # -> Curve, Points
preview_2 = CustomPreview(Geometry=overhang_extrusion, Material=colour_2)
item_12 = ListItem(List=split_2.Curve, Index=0, Wrap=True)
item_13 = ListItem(List=split.Curve, Index=1, Wrap=True)
pi = Pi(Factor=1)
angle = Angle(VectorA=bbx_2.Curves, VectorB=item_13, Plane=PlaneXY(8.363923435, -19.13795443, 0))  # -> Angle, Reflex
angle_2 = Angle(VectorA=bbx_2.Curves, VectorB=item_12, Plane=PlaneXY(8.363923435, -19.13795443, 0))  # -> Angle, Reflex
ins = InsertItems(List=item_13, Item=item_12, Indices=1, Wrap=True)
subtraction = Subtraction(A=pi, B=angle.Angle)
subtraction_2 = Subtraction(A=angle_2.Angle, B=pi)
sort = SortList(Keys=ins)  # -> Keys, ValuesA
fin_division = Slider(1.673, range=1..10)
max = Maximum(A=subtraction, B=subtraction_2)
item_14 = ListItem(List=sort.Keys, Index=0, Wrap=True)
cos_2 = Cosine(Value=max)
sin = Sine(Value=max)
multiplication_2 = Multiplication(A=cos_2, B=item_14)
multiplication_3 = Multiplication(A=sin, B=item_14)
division_3 = Division(A=multiplication_3, B=fin_division)
division_4 = Division(A=multiplication_2, B=fin_division)
divdist = DivideDistance(Curve=intcrv.Curve, Distance=division_4)  # -> Points, Tangents, Parameters
colour_3 = ColourPicker(PickedColour=RGBA(255, 255, 255, 174))
line_2 = LineSDL(Start=divdist.Points, Direction=Vector(0, -41.125903, 0), Length=division_3)
md_slider = MDSlider(
    SliderMode=0,
    slider_value=Point(0.5044034632, 0.4955946759, 0.5),
    x_domain=Domain(0, 1),
    y_domain=Domain(0, 1),
    z_domain=Domain(0, 1))
extr = Extrude(Base=line_2, Direction=Vector(0, 0, -15.73385373))
fin_thickness = Slider(7.676, range=1..10)
evalsrf = EvaluateSurface(Surface=reparameterize(extr), Point=md_slider)  # -> Point, Normal, UDirection, VDirection, Frame
division_5 = Division(A=evalsrf.Normal, B=fin_thickness)
rev_2 = Reverse(Vector=division_5)
fins = Extrude(Base=extr, Direction=division_5)
extr_2 = Extrude(Base=extr, Direction=rev_2)
fins_2 = SolidUnion(Breps=[fins, extr_2])
preview_3 = CustomPreview(Geometry=fins_2, Material=colour_3)
