# Grasshopper definition solar_path.gh (Grasshopper 1.0.7)

number_slider = Slider(100, range=0..100)
series = Series(Start=-23.5, Step=23.5, Count=3)
P = Plane(PlaneXY(0, 0, 0))
neg = Negative(Value=number_slider)
pt = ConstructPoint(XCoordinate=0, YCoordinate=number_slider, ZCoordinate=0)
c_script = CSharpScript(r=number_slider, LAT=Slider(33, range=-90..90))  # -> out, dh, ds, dt, rh, rs, hours; inputs r: Double, LAT: Double
# ---------- c_script: C# ----------
    //Convert degree input to radians
    double cdr = (Math.PI / 180);

    //Create DEC list, add DEC values
    List<double> DEC = new List<double>();
    DEC.Add(-23.45);  /*December 22*/
    DEC.Add(-18.00);  /*November 11 & January 30*/
    DEC.Add(-09.00);  /*October 14 & February 27*/
    DEC.Add(0.00);    /*March 21 & September 23*/
    DEC.Add(09.00);   /*April 14 & August 28*/
    DEC.Add(18.00);   /*May 12 & August 1*/
    DEC.Add(23.45);   /*June 22*/



    //Create ALT list, add ALT values
    List<double> ALT = new List<double>();
    ALT.Add(90.00 - LAT - 23.45);
    ALT.Add(90.00 - LAT - 18.00);
    ALT.Add(90.00 - LAT - 09.00);
    ALT.Add(90.00);
    ALT.Add(90.00 - LAT + 09.00);
    ALT.Add(90.00 - LAT + 18.00);
    ALT.Add(90.00 - LAT + 23.45);


    //Create rs (radius of sun path arc) values
    //double rs1 = (r * Math.Cos(DEC[0] * cdr)) / (Math.Sin(LAT * cdr) + Math.Sin(DEC[0] * cdr));
    //double rs1 = (r * Math.Cos(DEC[0] * cdr)) / (Math.Sin(LAT * cdr) + Math.Sin(DEC[0] * cdr));
    //double rs2 = (r * Math.Cos(DEC[1] * cdr)) / (Math.Sin(LAT * cdr) + Math.Sin(DEC[1] * cdr));
    //double rs3 = (r * Math.Cos(DEC[2] * cdr)) / (Math.Sin(LAT * cdr) + Math.Sin(DEC[2] * cdr));
    //double rs1 = (r * Math.Cos(DEC[0] * cdr)) / (Math.Sin(LAT * cdr) + Math.Sin(DEC[0] * cdr));
    //double rs1 = (r * Math.Cos(DEC[0] * cdr)) / (Math.Sin(LAT * cdr) + Math.Sin(DEC[0] * cdr));


    //Add values to rs list
    List<double> rs_input = new List<double>();
    foreach (double d in DEC) {
      rs_input.Add((r * Math.Cos(d * cdr)) / (Math.Sin(LAT * cdr) + Math.Sin(d * cdr)));
    }

    //Create ds (distance of rs from centre) values
    double ds1 = (r * (Math.Cos(LAT * cdr))) / (Math.Sin(LAT * cdr) + Math.Sin(DEC[0] * cdr));
    double ds2 = (r * Math.Cos(LAT * cdr)) / (Math.Sin(LAT * cdr) + Math.Sin(DEC[1] * cdr));
    double ds3 = (r * (Math.Cos(LAT * cdr))) / (Math.Sin(LAT * cdr) + Math.Sin(DEC[2] * cdr));

    //Add values to ds list
    List<double> ds_input = new List<double>();
    foreach (double d in DEC) {
      ds_input.Add((r * (Math.Cos(LAT * cdr))) / (Math.Sin(LAT * cdr) + Math.Sin(d * cdr)));
    }

    //Create dt (distance of hour line from centre)
    double dt_input = (r * Math.Tan(LAT * cdr));

    //Create HRA (hour line) values
    List<int> HRA = new List<int>();
    int i = 15;
    for(i = -90; i <= 90; i += 15)
    {
      HRA.Add(i);
    }

    //Create dh ( hour line horiz. distance from vertical)
    List<double> dh_input = new List<double>();
    foreach (double hour in HRA)
    {
      {
        double dh_values = r / (Math.Cos(LAT * cdr) * Math.Tan(hour * cdr));
        dh_input.Add(dh_values);
      }
    }

    //dh_input.Remove(double.PositiveInfinity);
    //dh_input.Add(0);
    //dh_input.Sort();

    //Create rh (radius of hour line)
    List<double> rh_input = new List<double>();
    foreach (double hour in HRA)
    {
      double rh_values = r / ((Math.Cos(LAT * cdr)) * (Math.Sin(hour * cdr)));
      rh_input.Add(rh_values);
    }

    //rh_input.Remove(double.PositiveInfinity);
    //rh_input.Sort();


    ds = ds_input;
    rs = rs_input;
    dh = dh_input;
    rh = rh_input;
    dt = dt_input;
    hours = HRA;
# ---------- end c_script ----------
pt_2 = ConstructPoint(XCoordinate=0, YCoordinate=neg, ZCoordinate=0)
ln = Line(StartPoint=pt, EndPoint=pt_2)
Y = UnitY(Factor=c_script.ds)
circle = CircleCNR(Center=P, Normal=Vector(0, 0, 1), Radius=c_script.rs)
base_circle = Circle(Plane=P, Radius=number_slider)
pt_3 = ConstructPoint(XCoordinate=c_script.dh, YCoordinate=0, ZCoordinate=0)
dec_lines = Move(Geometry=circle, Motion=Y)  # -> Geometry, Transform
Y_2 = UnitY(Factor=c_script.dt)
panel = Panel(c_script.hours)
neg_2 = Negative(Value=c_script.dt)
move = Move(Geometry=pt_3, Motion=Y_2)  # -> Geometry, Transform
Y_3 = UnitY(Factor=neg_2)
ccx = CurveCurve(CurveA=base_circle, CurveB=dec_lines.Geometry)  # -> Points, ParamsA, ParamsB
circle_2 = CircleCNR(Center=move.Geometry, Normal=Vector(0, 0, 1), Radius=c_script.rh)
multiplication = Multiplication(A=Y_3, B=2)
shatter = Shatter(Curve=graft(dec_lines.Geometry), Parameters=ccx.ParamsB)
hr_lines = Move(Geometry=circle_2, Motion=multiplication)  # -> Geometry, Transform
branch = TreeBranch(Tree=ccx.ParamsA, Path="{0;0;0}", MaintainPaths=True)
list = ValueList({"Jan": 0, "Feb": 31, "Mar": 59, "Apr": 90, "May": 120, "Jun": 151, "Jul": 182, "Aug": 212, "Sep": 243, "Oct": 273, "Nov": 304, "Dec": 334}, selected="Aug")
branch_2 = TreeBranch(Tree=ccx.ParamsA, Path="{0;0;6}", MaintainPaths=True)
list_2 = ValueList({"True", "False"}, selected="False")
item = ListItem(List=flatten(ccx.ParamsA), Index=[0, 1, 12, 13], Wrap=True)
cull_i = CullIndex(List=shatter, Indices=1, Wrap=True)
bbx = BrepBrep(BrepA=base_circle, BrepB=hr_lines.Geometry)  # -> Curves, Points
shatter_2 = Shatter(Curve=graft(base_circle), Parameters=flatten([branch, branch_2]))
c_script_2 = CSharpScript(month=list, day=Slider(21, range=0..31), leap_year=list_2)  # -> out, A; inputs month: Int32, day: Int32, leap_year: Boolean
# ---------- c_script_2: C# ----------
    int month_count = month;
    int day_count = day;
    bool leap_count = leap_year;
    int date_number;

    if (leap_count == true)
    {
      date_number = day + month_count;
    }

    else
    {
      date_number = day + month_count - 1;
    }

    A = Math.Abs((date_number - 172) / 183.0);
# ---------- end c_script_2 ----------
range = Range(Domain=Domain(0, 1), Steps=30)
item_2 = ListItem(List=shatter_2, Index=1, Wrap=True)
panel_2 = Panel(hr_lines.Geometry)
crvdom = CurveDomain(Curve=item_2, Domain=Domain(0, 1))  # -> Curve, Domain
panel_3 = Panel(c_script_2.A)
eval = EvaluateCurve(Curve=crvdom.Curve, Parameter=c_script_2.A)  # -> Point, Tangent, Angle
branch_3 = TreeBranch(Tree=ccx.Points, Path="{0;0;0}", MaintainPaths=True)
branch_4 = TreeBranch(Tree=ccx.Points, Path="{0;0;1}", MaintainPaths=True)
branch_5 = TreeBranch(Tree=ccx.Points, Path="{0;0;2}", MaintainPaths=True)
branch_6 = TreeBranch(Tree=ccx.Points, Path="{0;0;3}", MaintainPaths=True)
branch_7 = TreeBranch(Tree=ccx.Points, Path="{0;0;4}", MaintainPaths=True)
branch_8 = TreeBranch(Tree=ccx.Points, Path="{0;0;5}", MaintainPaths=True)
branch_9 = TreeBranch(Tree=ccx.Points, Path="{0;0;6}", MaintainPaths=True)
tag = TextTag(Location=branch_3, Text="December 22")
tag_2 = TextTag(Location=branch_4, Text="Nov 11 / Jan 30")
tag_3 = TextTag(Location=branch_5, Text="Oct 13 / Feb 27")
tag_4 = TextTag(Location=branch_6, Text="Mar 21 / Sept 23")
tag_5 = TextTag(Location=branch_7, Text="Apr 14 / Aug 28")
tag_6 = TextTag(Location=branch_8, Text="May 12 / Aug 1")
tag_7 = TextTag(Location=branch_9, Text="June 22")
item_3 = ListItem(Index=0, Wrap=True)
domain = Domain(item_3)
remap = RemapNumbers(Value=item_3, Source=item_3, Target=Domain(0, 1))  # -> Mapped, Clipped
eval_2 = EvaluateCurve(Curve=item_3, Parameter=remap.Mapped)  # -> Point, Tangent, Angle
curvepoint = PointOnCurve(item_3, parameter=0.872)
