# Grasshopper definition solar_path_main.gh (Grasshopper 1.0.7)

minutes = Slider(0, range=0..60)
C = Count(13)
C_2 = Count(13)
series = Series(Start=-90, Step=15, Count=C)
division = Division(A=minutes, B=60)
number_slider = Slider(52, range=0..90)
number_slider_2 = Slider(13, range=0..13)
series_2 = Series(Start=-90, Step=15, Count=number_slider_2)
number_slider_3 = Slider(34, range=-90..90)
neg = Negative(Value=number_slider)
list = ValueList({"Equinox": 0, "Summer Solstice": 23.45, "Winter Solstice": -23.45}, selected="Summer Solstice")
series_3 = Series(Start=-23.5, Step=23.5, Count=3)
series_4 = Series(Start=neg, Step=number_slider, Count=number_slider_2)
number_slider_4 = Slider(50, range=0..100)
c_script = CSharpScript(x=series_4)  # -> out, A; inputs x: Double
# ---------- c_script: C# ----------
    A = x * (Math.PI / 180);
# ---------- end c_script ----------
c_script_2 = CSharpScript(x=series_3)  # -> out, A; inputs x: Double; same code as c_script
convert_to_radians = CSharpScript(x=number_slider_3)  # -> out, A; inputs x: Double; same code as c_script
series_5 = Series(Start=0, Step=1, Count=10)
c_script_3 = CSharpScript(r=number_slider_4, LAT=number_slider_3, DEC=series_3)  # -> out, ds, dt, dh, rh, rs; inputs r: Double, LAT: Double, DEC: list of Double
# ---------- c_script_3: C# ----------
    /*Convert degree input to radians*/
    double cdr = (Math.PI / 180);

    List<double> ALT = new List<double>();
    ALT.Add(90 - LAT - 23.45);
    ALT.Add(90);
    ALT.Add(90 - LAT + 23.45);

    double rs1 = (r * Math.Cos(DEC[0] * cdr)) / (Math.Sin(ALT[0] * cdr) + Math.Sin(DEC[0] * cdr));
    double rs2 = (r * Math.Abs(Math.Cos(DEC[1] * cdr)) / (Math.Sin(ALT[1] * cdr)) + Math.Sin(DEC[1] * cdr));
    double rs3 = r * (Math.Cos(DEC[2] * cdr)) / (Math.Sin(ALT[2] * cdr)) + (Math.Sin(DEC[2] * cdr));

    List<double> rs_input = new List<double>();
    rs_input.Add(rs1);
    rs_input.Add(rs2);
    rs_input.Add(rs3);

    double ds1 = (r * Math.Cos(LAT * cdr)) / (Math.Sin(LAT * cdr) + Math.Sin(DEC[0] * cdr));
    double ds2 = (r * Math.Cos(LAT * cdr)) / (Math.Sin(LAT * cdr) + Math.Sin(DEC[1] * cdr));
    double ds3 = (r * Math.Cos(LAT * cdr)) / (Math.Sin(LAT * cdr) + Math.Sin(DEC[2] * cdr));

    List<double> ds_input = new List<double>();
    ds_input.Add(ds1);
    ds_input.Add(ds2);
    ds_input.Add(ds3);


    //dt = r * (Math.Tan(LAT));
    //dh = r / (Math.Cos(LAT)) * Math.Tan(HRA);
    //rh = r / (Math.Cos(LAT)) * Math.Sin(HRA);

    ds = ds_input;
    rs = rs_input;
    dt = Math.Sin(LAT * cdr) + Math.Sin(DEC[0] * cdr);
    rh = DEC[2];
# ---------- end c_script_3 ----------
panel = Panel(c_script_3.rs)
cir = Circle(Plane=PlaneXY(0, 0, 0), Radius=number_slider_4)
panel_2 = Panel(c_script_3.ds)
darc = DeconstructArc(Arc=cir)  # -> BasePlane, Radius, Angle
panel_3 = Panel(c_script_3.rh)
Y = UnitY(Factor=1)
item = ListItem(List=c_script_3.ds, Index=Slider(3, range=0..10), Wrap=True)
panel_4 = Panel(c_script_3.dt)
line = LineSDL(Start=darc.BasePlane, Direction=Y, Length=c_script_3.ds)
cir_2 = Circle(Plane=PlaneXY(0, 0, 0), Radius=1)
cp = ControlPoints(Curve=cir_2)  # -> Points, Weights, Knots
end = EndPoints(Curve=line)  # -> Start, End
cir_3 = Circle(Plane=end.End, Radius=c_script_3.rs)
darc_2 = DeconstructArc(Arc=cir_2)  # -> BasePlane, Radius, Angle
item_2 = ListItem(List=cp.Points, Index=4, Wrap=True)
item_3 = ListItem(List=cp.Points, Index=8, Wrap=True)
neg_2 = Negative()
ln = Line(StartPoint=item_2, EndPoint=item_3)
ext = ExtendCurve(Curve=ln, Type=0)
pt = ConstructPoint(XCoordinate=darc_2.BasePlane, YCoordinate=neg_2, ZCoordinate=0)
Y_2 = UnitY(Factor=1)
move = Move(Geometry=ext, Motion=Y_2)  # -> Geometry, Transform
circle = CircleCNR(Center=pt, Normal=Vector(0, 0, 1), Radius=1)
vdisex = VectorDisplayEx(Colour=RGB(0, 0, 0), Width=2)
trim = TrimWithRegion(Curve=circle, Region=cir_2)  # -> Inside, Outside
item_4 = ListItem(List=trim.Inside, Index=0, Wrap=True)
