# Grasshopper definition solar_path_simplified.gh (Grasshopper 1.0.7)
# plug-ins: Kangaroo2 Components

list = ValueList({"Jan": 0, "Feb": 31, "Mar": 59, "Apr": 90, "May": 120, "Jun": 151, "Jul": 182, "Aug": 212, "Sep": 243, "Oct": 273, "Nov": 304, "Dec": 334}, selected="Jun")
list_2 = ValueList({"True", "False"}, selected="False")
c_script = CSharpScript(month=list, day=Slider(21, range=0..31), leap_year=list_2)  # -> out, A; inputs month: Int32, day: Int32, leap_year: Boolean
# ---------- c_script: C# ----------
    int month_count = month;
    int day_count = day;
    bool leap_count = leap_year;
    int date_number;

    if (leap_count == true)
    {
      date_number = day + month_count;
    }

    else
    {
      date_number = day + month_count - 1;
    }

    A = Math.Abs((date_number - 172) / 183.0);
# ---------- end c_script ----------
range = Range(Domain=Domain(0, 1), Steps=10)
number_slider = Slider(100, range=0..100)

list_3 = ValueList({"Jan": 0, "Feb": 31, "Mar": 59, "Apr": 90, "May": 120, "Jun": 151, "Jul": 182, "Aug": 212, "Sep": 243, "Oct": 273, "Nov": 304, "Dec": 334}, selected="Nov")
list_4 = ValueList({"True", "False"}, selected="False")
c_script_2 = CSharpScript(r=number_slider, month=list_3, day=Slider(3, range=0..31), leap_year=list_4, LAT=Slider(22, range=-90..90))  # -> out, dh, ds, dt, ra, rh, rs, hours, DEC_date_value, ALT_value; inputs r: Double, month: Int32, day: Int32, leap_year: Boolean, LAT: Double
# ---------- c_script_2: C# ----------
    //Convert degree input to radians
    double cdr = (Math.PI / 180);

    //List month, day, date, and leap year option
    int month_count = month;
    int day_count = day;
    int julian_date = month_count + day_count;
    int date_number;
    bool leap_count = leap_year;

    //Leap Year toggle: True or False
    if (leap_count == true)
    {
      date_number = day + month_count;
    }

    else
    {
      date_number = day + month_count - 1;
    }

    //Create specific DEC value for specific list
    double DEC_date = 23.45 * Math.Sin((360 * (284 + julian_date) / 365) * cdr);

    //Create specific HRA for specific list

    //Create DEC list, add DEC values
    List<double> DEC = new List<double>();
    DEC.Add(-23.45);  //December 22
    DEC.Add(-18.00);  //November 11 & January 30
    DEC.Add(-09.00);  //October 14 & February 27
    DEC.Add(0.00);    //March 21 & September 23
    DEC.Add(09.00);   //April 14 & August 28
    DEC.Add(18.00);   //May 12 & August 1
    DEC.Add(23.45);   //June 22
    DEC.Add(DEC_date);

    //Create ALT list, add ALT values
    List<double> ALT = new List<double>();
    ALT.Add(90.00 - LAT - 23.45);
    ALT.Add(90.00 - LAT - 18.00);
    ALT.Add(90.00 - LAT - 09.00);
    ALT.Add(90.00);
    ALT.Add(90.00 - LAT + 09.00);
    ALT.Add(90.00 - LAT + 18.00);
    ALT.Add(90.00 - LAT + 23.45);

    //Create ALT_circles list, add ALT_circles values
    List<double> ALT_circles = new List<double>();
    ALT_circles.Add(10.00);
    ALT_circles.Add(20.00);
    ALT_circles.Add(30.00);
    ALT_circles.Add(40.00);
    ALT_circles.Add(50.00);
    ALT_circles.Add(60.00);
    ALT_circles.Add(70.00);
    ALT_circles.Add(80.00);
    ALT_circles.Add(90.00);

    //Create rs (radius of sun path arc) values
    //double rs1 = (r * Math.Cos(DEC[0] * cdr)) / (Math.Sin(LAT * cdr) + Math.Sin(DEC[0] * cdr));
    //double rs1 = (r * Math.Cos(DEC[0] * cdr)) / (Math.Sin(LAT * cdr) + Math.Sin(DEC[0] * cdr));
    //double rs2 = (r * Math.Cos(DEC[1] * cdr)) / (Math.Sin(LAT * cdr) + Math.Sin(DEC[1] * cdr));
    //double rs3 = (r * Math.Cos(DEC[2] * cdr)) / (Math.Sin(LAT * cdr) + Math.Sin(DEC[2] * cdr));
    //double rs1 = (r * Math.Cos(DEC[0] * cdr)) / (Math.Sin(LAT * cdr) + Math.Sin(DEC[0] * cdr));
    //double rs1 = (r * Math.Cos(DEC[0] * cdr)) / (Math.Sin(LAT * cdr) + Math.Sin(DEC[0] * cdr));

    //Add values to rs list
    List<double> rs_input = new List<double>();
    foreach (double d in DEC) {
      rs_input.Add((r * Math.Cos(d * cdr)) / (Math.Sin(LAT * cdr) + Math.Sin(d * cdr)));
    }

    //Create ds (distance of rs from centre) values
    double ds1 = (r * (Math.Cos(LAT * cdr))) / (Math.Sin(LAT * cdr) + Math.Sin(DEC[0] * cdr));
    double ds2 = (r * Math.Cos(LAT * cdr)) / (Math.Sin(LAT * cdr) + Math.Sin(DEC[1] * cdr));
    double ds3 = (r * (Math.Cos(LAT * cdr))) / (Math.Sin(LAT * cdr) + Math.Sin(DEC[2] * cdr));

    //Add values to ds list
    List<double> ds_input = new List<double>();
    foreach (double d in DEC) {
      ds_input.Add((r * (Math.Cos(LAT * cdr))) / (Math.Sin(LAT * cdr) + Math.Sin(d * cdr)));
    }

    //Create dt (distance of hour line from centre)
    double dt_input = (r * Math.Tan(LAT * cdr));

    //Create HRA (hour line) values
    List<double> HRA = new List<double>();
    int i = 15;
    for(i = -90; i <= 90; i += 15)
    {
      HRA.Add(i);
    }

    //Create dh ( hour line horiz. distance from vertical)
    List<double> dh_input = new List<double>();
    foreach (double hour in HRA)
    {
      {
        double dh_values = r / (Math.Cos(LAT * cdr) * Math.Tan(hour * cdr));
        dh_input.Add(dh_values);
      }
    }

    //dh_input.Remove(double.PositiveInfinity);
    //dh_input.Add(0);
    //dh_input.Sort();

    //Create rh (radius of hour line)
    List<double> rh_input = new List<double>();
    foreach (double hour in HRA)
    {
      double rh_values = r / ((Math.Cos(LAT * cdr)) * (Math.Sin(hour * cdr)));
      rh_input.Add(rh_values);
    }

    //rh_input.Remove(double.PositiveInfinity);
    //rh_input.Sort();

    //Create altitude circles
    List<double> ra_input = new List<double>();
    foreach (double a in ALT) {
      ra_input.Add((r * (Math.Cos(a * cdr))) / (1 + Math.Sin(a * cdr)));
    }
    //double ra_input = ((r*(Math.Cos(ALT * cdr))) / (1 + Math.Sin(ALT * cdr)));

    //Create specific altitudes list
    List<double> ALT_values = new List<double>();
    foreach (double hour in HRA) {
      ALT_values.Add((Math.Asin(
        (
        (Math.Sin(DEC_date * cdr)) * (Math.Sin(LAT * cdr))
        )
        +
        (
        (Math.Cos(DEC_date * cdr)) * (Math.Cos(LAT * cdr)) * (Math.Cos(hour * cdr))
        )
        ))*180/Math.PI);
    }

    //List<double> ALT_degrees = new List<double>

    ds = ds_input;
    rs = rs_input;
    dh = dh_input;
    rh = rh_input;
    dt = dt_input;
    ra = ALT_circles;
    hours = HRA;
    DEC_date_value = DEC_date;
    ALT_value = ALT_values;
    //t = Math.Abs((date_number - 172) / 183.0);
# ---------- end c_script_2 ----------

P = Plane(PlaneXY(0, 0, 0))
base_circle = Circle(Plane=P, Radius=number_slider)
Y = UnitY(Factor=c_script_2.ds)
circle = CircleCNR(Center=P, Normal=Vector(0, 0, 1), Radius=c_script_2.rs)
dec_lines = Move(Geometry=circle, Motion=Y)  # -> Geometry, Transform

pt = ConstructPoint(XCoordinate=c_script_2.dh, YCoordinate=0, ZCoordinate=0)
Y_2 = UnitY(Factor=c_script_2.dt)
neg = Negative(Value=c_script_2.dt)
move = Move(Geometry=pt, Motion=Y_2)  # -> Geometry, Transform
Y_3 = UnitY(Factor=neg)
circle_2 = CircleCNR(Center=move.Geometry, Normal=Vector(0, 0, 1), Radius=c_script_2.rh)
multiplication = Multiplication(A=Y_3, B=2)
hr_lines = Move(Geometry=circle_2, Motion=multiplication)  # -> Geometry, Transform
bbx = BrepBrep(BrepA=base_circle, BrepB=hr_lines.Geometry)  # -> Curves, Points

ccx = CurveCurve(CurveA=base_circle, CurveB=dec_lines.Geometry)  # -> Points, ParamsA, ParamsB
branch = TreeBranch(Tree=ccx.ParamsA, Path="{0;0;0}", MaintainPaths=True)
branch_2 = TreeBranch(Tree=ccx.ParamsA, Path="{0;0;6}", MaintainPaths=True)
shatter = Shatter(Curve=graft(base_circle), Parameters=flatten([branch, branch_2]))
item = ListItem(List=shatter, Index=1, Wrap=True)
crvdom = CurveDomain(Curve=item, Domain=Domain(0, 1))  # -> Curve, Domain

shatter_2 = Shatter(Curve=graft(dec_lines.Geometry), Parameters=ccx.ParamsB)
cull_i = CullIndex(List=shatter_2, Indices=1, Wrap=True)
item_2 = ListItem(List=flatten(cull_i), Index=7, Wrap=True)
panel = Panel(c_script_2.ALT_value)
ccx_2 = CurveCurve(CurveA=item_2, CurveB=flatten(bbx.Curves))  # -> Points, ParamsA, ParamsB
midpt = CurveMiddle(Curve=item_2)
duppt = RemoveDuplicatePts(Points=flatten(ccx_2.Points), Tolerance=1)
flatten = FlattenTree(Tree=ccx_2.Points, Path="{0}")
Z = UnitZ(Factor=panel)
sort_pt = SortPoints(Points=duppt)  # -> Points, Indices
branch_3 = TreeBranch(Path="{0;0;0}", MaintainPaths=True)
branch_4 = TreeBranch(Path="{0;0;1}", MaintainPaths=True)
branch_5 = TreeBranch(Path="{0;0;2}", MaintainPaths=True)
branch_6 = TreeBranch(Path="{0;0;3}", MaintainPaths=True)
branch_7 = TreeBranch(Path="{0;0;4}", MaintainPaths=True)
branch_8 = TreeBranch(Path="{0;0;5}", MaintainPaths=True)
branch_9 = TreeBranch(Path="{0;0;6}", MaintainPaths=True)
tag = TextTag(Location=branch_3, Text="December 22")
tag_2 = TextTag(Location=branch_4, Text="Nov 11 / Jan 30")
tag_3 = TextTag(Location=branch_5, Text="Oct 13 / Feb 27")
tag_4 = TextTag(Location=branch_6, Text="Mar 21 / Sept 23")
tag_5 = TextTag(Location=branch_7, Text="Apr 14 / Aug 28")
tag_6 = TextTag(Location=branch_8, Text="May 12 / Aug 1")
tag_7 = TextTag(Location=branch_9, Text="June 22")
ins = InsertItems(List=sort_pt.Points, Item=midpt, Indices=6, Wrap=True)
panel_2 = Panel(ins)
move_2 = Move(Geometry=ins, Motion=Z)  # -> Geometry, Transform
intcrv_t = InterpolateT(TangentStart=Vector(0, 0, 0), TangentEnd=Vector(0, 0, 0), KnotStyle=1)  # -> Curve, Length, Domain
item_3 = ListItem(Index=0, Wrap=True)
intcrv = Interpolate(Vertices=move_2.Geometry, Degree=3, Periodic=False, KnotStyle=1)  # -> Curve, Length, Domain
domain = Domain(item_3)
remap = RemapNumbers(Value=item_3, Source=item_3, Target=Domain(0, 1))  # -> Mapped, Clipped
eval = EvaluateCurve(Curve=item_3, Parameter=remap.Mapped)  # -> Point, Tangent, Angle
curvepoint = PointOnCurve(item_3, parameter=0.872)
