# Grasshopper definition solar_path_ultra_simplified.gh (Grasshopper 1.0.8)

number_slider = Slider(67.903, range=0..100)
P = Plane(PlaneXY(0, 0, 0))
xz = XZPlane(Origin=Point(0, 0, 0))
cir = Circle(Plane=P, Radius=number_slider)
arc = Arc(Plane=xz, Radius=number_slider, Angle=Domain(0, 3.141592654))  # -> Arc, Length
midpt = CurveMiddle(Curve=arc.Arc)
end = EndPoints(Curve=arc.Arc)  # -> Start, End
ln = Line(StartPoint=midpt, EndPoint=P)
yz = YZPlane(Origin=Point(0, 0, 0))
A = Angle([23.5, -23.5])
cos = Cosine(Value=degrees(A))
rotate = Rotate(Geometry=ln, Angle=degrees(A), Plane=yz)  # -> Geometry, Transform
multiplication = Multiplication(A=cos, B=number_slider)
end_2 = EndPoints(Curve=rotate.Geometry)  # -> Start, End
line = LineSDL(Start=end_2.Start, Direction=Vector(0, 0, -50.2698038), Length=multiplication)
end_3 = EndPoints(Curve=line)  # -> Start, End
sort_pt = SortPoints(Points=[midpt, end_3.Start])  # -> Points, Indices
line_2 = LineSDL(Start=end_3.End, Direction=graft([Vector(-148.1156425, 0, 0), Vector(138.2883609, 0, 0)]), Length=100)
ccx = CurveCurve(CurveA=line_2, CurveB=cir)  # -> Points, ParamsA, ParamsB
xz_2 = XZPlane(Origin=Point(0, 0, 0))
Y = UnitY(Factor=end_3.End)
surface_opening_height_from_ground = Slider(0, range=0..100)
width = Slider(45, range=0..100)
length = Slider(23, range=0..100)
latitude = Slider(25.711, range=-90..90)
day_of_the_year = Slider(1, range=1..183)
hour_1 = Slider(3, range=0..11)
minute_1 = Slider(30, range=0..59)
second_1 = Slider(42, range=0..59)
hour_2 = Slider(6, range=0..11)
minute_2 = Slider(24, range=0..59)
second_2 = Slider(56, range=0..59)
arc_2 = Arc(Plane=xz_2, Radius=multiplication, Angle=Domain(0, 3.141592654))  # -> Arc, Length
intcrv = Interpolate(Vertices=sort_pt.Points, Degree=3, Periodic=False, KnotStyle=1)  # -> Curve, Length, Domain
rev = Reverse(Vector=Y)
move = Move(Geometry=arc_2.Arc, Motion=[Y, rev])  # -> Geometry, Transform
degrees = Slider(-28, range=-90..90)
dom = ConstructDomain(DomainStart=1, DomainEnd=180)
length_2 = Slider(13, range=0..100)
remap = RemapNumbers(Value=day_of_the_year, Source=dom, Target=intcrv.Length)  # -> Mapped, Clipped
time = ConstructTime(Hour=12, Minute=0, Second=0)
time_2 = ConstructTime(Hour=0, Minute=0, Second=0)
time_3 = ConstructTime(Hour=hour_1, Minute=minute_1, Second=second_1)
rad = Radians(Degrees=degrees)
time_4 = ConstructTime(Hour=hour_2, Minute=minute_2, Second=second_2)
eval = EvaluateCurve(Curve=intcrv.Curve, Parameter=remap.Clipped)  # -> Point, Tangent, Angle
line_3 = LineSDL(Start=Point(0, 0, 0), Direction=Vector(48.62458515, 0, 0), Length=100)
dom_2 = ConstructDomain(DomainStart=time_2, DomainEnd=time)
arc_3 = Arc3Pt(PointA=end.Start, PointB=eval.Point, PointC=end.End)  # -> Arc, Plane, Radius
Y_2 = UnitY(Factor=length_2)
len = Length(Curve=arc_3.Arc)
divide = DivideCurve(Curve=line_3, Count=10, Kinks=False)  # -> Points, Tangents, Parameters
L = Length(15)
rev_2 = Reverse(Vector=Y_2)
remap_2 = RemapNumbers(Value=time_3, Source=dom_2, Target=len)  # -> Mapped, Clipped
remap_3 = RemapNumbers(Value=time_4, Source=dom_2, Target=len)  # -> Mapped, Clipped
line_4 = LineSDL(Start=Point(0, 0, 0), Direction=Vector(0, -16.45762102, 0), Length=L)
move_2 = Move(Geometry=divide.Points, Motion=rev_2)  # -> Geometry, Transform
len_2 = Length(Curve=line_4)
ln_2 = Line(StartPoint=divide.Points, EndPoint=move_2.Geometry)
eval_2 = EvaluateCurve(Curve=arc_3.Arc, Parameter=[remap_3.Clipped, remap_2.Clipped])  # -> Point, Tangent, Angle
neg = Negative(Value=latitude)
rot3d = Rotate3D(Geometry=ln_2, Angle=rad, Center=divide.Points, Axis=Vector(0, 0, 1))  # -> Geometry, Transform
rad_2 = Radians(Degrees=neg)
ln_3 = Line(StartPoint=eval_2.Point, EndPoint=Point(0, 0, 0))
rotate_2 = RotateDirection(Geometry=ln_2, Center=divide.Points, From=Vector(0, -36.38027736, 0), To=Vector(-21.20731507, -26.33517427, 0))  # -> Geometry, Transform
division = Division(A=length, B=2)
division_2 = Division(A=width, B=2)
end_4 = EndPoints(Curve=rot3d.Geometry)  # -> Start, End
rot3d_2 = Rotate3D(
    Geometry=[move.Geometry, intcrv.Curve, arc_3.Arc, ln_3, midpt],
    Angle=rad_2,
    Center=Point(0, 0, 0),
    Axis=Vector(-117.2510483, 0, 0))  # -> Geometry, Transform
Z = UnitZ(Factor=surface_opening_height_from_ground)
neg_2 = Negative(Value=division)
neg_3 = Negative(Value=division_2)
line_5 = LineSDL(Start=end_4.End, Direction=Vector(0, 9.49641867, 0), Length=length_2)
dom_3 = ConstructDomain(DomainStart=neg_3, DomainEnd=division_2)
dom_4 = ConstructDomain(DomainStart=neg_2, DomainEnd=division)
move_3 = Move(Geometry=rot3d_2.Geometry, Motion=Z)  # -> Geometry, Transform
item = ListItem(List=move_3.Geometry, Index=[6, 7], Wrap=True)
item_2 = ListItem(List=move_3.Geometry, Index=7, Wrap=True)
item_3 = ListItem(List=move_3.Geometry, Index=6, Wrap=True)
rectangle = Rectangle(Plane=PlaneXY(0, 0, 0), XSize=dom_3, YSize=dom_4, Radius=0)  # -> Rectangle, Length
item_4 = ListItem(List=item, Index=0, Wrap=True)
item_5 = ListItem(List=item, Index=1, Wrap=True)
boxrec = BoxRectangle(Rectangle=rectangle.Rectangle, Height=Slider(32, range=0..100))
end_5 = EndPoints(Curve=item_3)  # -> Start, End
end_6 = EndPoints(Curve=item_2)  # -> Start, End
debrep = DeconstructBrep(Brep=boxrec)  # -> Faces, Edges, Vertices
item_6 = ListItem(List=debrep.Faces, Index=[0, 2, 5], Wrap=True)  # -> graft(Item)
bcx = BrepCurve(Brep=item_6, Curve=[item_4, item_5])  # -> Curves, flatten(Points)
item_7 = ListItem(List=bcx.Points, Index=1, Wrap=True)
item_8 = ListItem(List=bcx.Points, Index=0, Wrap=True)
Z_2 = UnitZ(Factor=1)
Z_3 = UnitZ(Factor=Slider(9.43, range=0..100))
srf4pt = _4PointSurface(CornerA=end_5.Start, CornerB=end_6.Start, CornerC=item_7, CornerD=item_8)
move_4 = Move(Geometry=[item_7, item_8], Motion=Z_3)  # -> Geometry, Transform
line_6 = LineSDL(Start=move_4.Geometry, Direction=Vector(0, -96.9473087, 0), Length=1)
item_9 = ListItem(List=flatten(item_6), Index=0, Wrap=True)
item_10 = ListItem(List=flatten(item_6), Index=1, Wrap=True)
rev_3 = Reverse(Vector=Z_3)
intcrv_2 = Interpolate(Vertices=move_4.Geometry, Degree=3, Periodic=False, KnotStyle=1)  # -> Curve, Length, Domain
ln2pl = Line2Plane(Line=line_6, PlaneA=item_9, PlaneB=srf4pt)
loft = Loft(Curves=ln2pl, Options={Adjust=False, Closed=False, LoftEnds=0, LoftSimp=0, LoftType=0, Rebuild=10, Refit=0.01})
bbx = BrepBrep(BrepA=boxrec, BrepB=loft)  # -> Curves, Points
project = Project(Geometry=srf4pt, Plane=loft)  # -> Geometry, Transform
bbx_2 = BrepBrep(BrepA=project.Geometry, BrepB=srf4pt)  # -> Curves, Points
edges = BrepEdges(Brep=project.Geometry)  # -> Naked, Interior, NonManifold
item_11 = ListItem(List=edges.Naked, Index=1, Wrap=True)
item_12 = ListItem(List=edges.Naked, Index=3, Wrap=True)
split = SplitWithBrep(Curve=item_12, Brep=srf4pt)  # -> Curve, Points
split_2 = SplitWithBrep(Curve=item_11, Brep=srf4pt)  # -> Curve, Points
item_13 = ListItem(List=split_2.Curve, Index=1, Wrap=True)
item_14 = ListItem(List=split.Curve, Index=0, Wrap=True)
ins = InsertItems(List=item_13, Item=item_14, Indices=1, Wrap=True)
angle = Angle(VectorA=bbx_2.Curves, VectorB=item_14, Plane=PlaneXY(8.363923435, -19.13795443, 0))  # -> Angle, Reflex
angle_2 = Angle(VectorA=bbx_2.Curves, VectorB=item_13, Plane=PlaneXY(8.363923435, -19.13795443, 0))  # -> Angle, Reflex
pi = Pi(Factor=1)
pi_2 = Pi(Factor=1)
sort = SortList(Keys=ins)  # -> Keys, ValuesA
subtraction = Subtraction(A=pi, B=angle_2.Angle)
subtraction_2 = Subtraction(A=angle.Angle, B=pi_2)
max = Maximum(A=subtraction, B=subtraction_2)
item_15 = ListItem(List=sort.Keys, Index=0, Wrap=True)
number_slider_2 = Slider(3, range=0..100)
sin = Sine(Value=max)
cos_2 = Cosine(Value=max)
multiplication_2 = Multiplication(A=sin, B=item_15)
multiplication_3 = Multiplication(A=cos_2, B=item_15)
divdist = DivideDistance(Curve=intcrv_2.Curve, Distance=multiplication_3)  # -> Points, Tangents, Parameters
