# Grasshopper definition split_wall.gh (Grasshopper 0.9.70)

box = CenterBox(Base=PlaneXY(0, 0, 0), X=Slider(0.613, range=0..20), Y=Slider(5, range=0..20), Z=Slider(0.05, range=0..20))
debrep = DeconstructBrep(Brep=box)  # -> Faces, Edges, Vertices
move = Move(Geometry=box, Motion=Vector(0, 0, 10))  # -> Geometry, Transform
item = ListItem(List=debrep.Faces, Index=5, Wrap=True)
debrep_2 = DeconstructBrep(Brep=move.Geometry)  # -> Faces, Edges, Vertices
area = Area(Geometry=item)  # -> Area, Centroid
area_2 = Area(Geometry=debrep_2.Faces)  # -> Area, Centroid
item_2 = ListItem(List=debrep_2.Faces, Index=4, Wrap=True)
item_3 = ListItem(List=area.Centroid, Index=5, Wrap=True)
item_4 = ListItem(List=area_2.Centroid, Index=4, Wrap=True)
divide = DivideDomain²(Domain=item_2, UCount=10, VCount=1)
dist = Distance(PointA=item_4, PointB=item_3)
subsrf = Isotrim(Surface=item_2, Domain=divide)
culln = CullNth(List=subsrf, CullFrequency=2)
neg = Negative(Value=dist)
Z = UnitZ(Factor=neg)
extr = Extrude(Base=culln, Direction=Z)
debrep_3 = DeconstructBrep(Brep=extr)  # -> Faces, Edges, Vertices
item_5 = ListItem(List=debrep_3.Edges, Index=0, Wrap=True)
item_6 = ListItem(List=item_5, Index=0, Wrap=True)
item_7 = ListItem(List=debrep_3.Faces, Index=2, Wrap=True)
len = Length(Curve=item_6)
cull = CullPattern(List=flatten(item_7), CullPattern=[False, True])
item_8 = ListItem(List=len, Index=0, Wrap=True)
cull_2 = CullPattern(List=flatten(item_7), CullPattern=[True, False])
divide_2 = DivideDomain²(Domain=cull_2, UCount=Slider(20, range=0..20), VCount=1)
divide_3 = DivideDomain²(Domain=cull, UCount=Slider(42, range=0..50), VCount=1)
subsrf_2 = Isotrim(Surface=graft(cull), Domain=divide_3)
subsrf_3 = Isotrim(Surface=graft(cull_2), Domain=divide_2)
cull_3 = CullPattern(List=subsrf_2, CullPattern=[False, True])
cull_4 = CullPattern(List=subsrf_3, CullPattern=[True, False])
Y = UnitY(Factor=item_8)
Y_2 = UnitY(Factor=item_8)
extr_2 = Extrude(Base=cull_4, Direction=Y)
extr_3 = Extrude(Base=cull_3, Direction=Y_2)
